# Grasshopper definition Polymers_RobotPrint.gh (Grasshopper 0.9.76)

print_resolution_rhino_units = Slider(3, range=0..50)
interpolation_mode = ValueList({"Move Linear": 0, "MoveFly Linear": 1}, selected="MoveFly Linear")
file_name = Panel("My File Name")
custom_subdir = Panel("My Sub-Directory Name")
local_directory = ValueList({"Desktop": 0, "C:": 1, "Documents": 2}, selected="Desktop")
z_bridges_rhino_units = Panel("10")
arm_override_general = Panel("15")
extrusion_factor = Panel("0.5")
# 3D print trajectory simulation
delay = Panel("2000")
feedrate = Panel("260")
# 3D print parameters
temperature = Panel("200")
# file
arm_override_move = Panel("10")
arm_override_print = Panel("2")
# deposition
print_mode = ValueList({"Stop&run": 0, "Run": 1}, selected="Run")
# arm speed
list = ValueList({"$ARM_OVR": 0, "$ARM_SPD_OVR": 1}, selected="$ARM_SPD_OVR")
save_pdl_file = Button()
save_gh_file = Button()
# input geometry
crv = Curve(flatten([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]))

# ---- group: CURVES SUBDIVISION
divlength = DivideLength(Curve=flatten(crv), Length=print_resolution_rhino_units)  # -> Points, Tangents, Parameters

# ----
vec = VectorXYZ(XComponent=0, YComponent=z_bridges_rhino_units, ZComponent=z_bridges_rhino_units)  # -> Vector, Length

# ---- group: FORMAT and PARSE ROBOT INSTRUCTIONS / stop EXTRUSION
expression = Expression(x="WRITE vi_lun_w ('G1 E", y="-0.5", z="', NL) -- Stop extrusion", Expression="x&y&z")

# ----
int = Integer(arm_override_print)
txt = Text(file_name)
int_2 = Integer(arm_override_move)

# ---- group: ADD POINTS FOR Z BRIDGES
item = ListItem(List=divlength.Points, Index=0, Wrap=True)
merge = Merge(Data1=simplify(divlength.Points), Data2=simplify(item), Data3=simplify(item))
item_2 = ListItem(List=merge, Index="0", Wrap=True)
item_3 = ListItem(List=merge, Index="-1", Wrap=True)
move = Move(Geometry=item_3, Motion=vec.Vector)  # -> Geometry, Transform
move_2 = Move(Geometry=item_2, Motion=vec.Vector)  # -> Geometry, Transform
merge_2 = Merge(Data1=move_2.Geometry, Data2=merge, Data3=move.Geometry)

# ---- group: ADD POINTS FOR Z BRIDGES / REPLACE FIRST PT
branch = TreeBranch(Tree=merge_2, Path="{0}", MaintainPaths=True)
item_4 = ListItem(List=flatten(branch), Index=0, Wrap=True)
pdecon = Deconstruct(Point=item_4)  # -> XComponent, YComponent, ZComponent
pt = ConstructPoint(XCoordinate=expr("x-30", pdecon.XComponent), YCoordinate=expr("x-30", pdecon.YComponent), ZCoordinate=0)
replace = ReplaceItems(List=flatten(merge_2), Item=pt, Indices=0, Wrap=False)
unflatten = UnflattenTree(Tree=replace, Guide=merge_2)

# ---- group: ADD POINTS FOR Z BRIDGES (continued)
filter = StreamFilter(Gate=print_mode, Stream0=unflatten, Stream1=divlength.Points)

# ----
pt_2 = Point(filter)

# ---- group: DISTANCES >>> EXTRUSION FACTOR
flatten = FlattenTree(Tree=pt_2, Path="{0}")
shift = ShiftList(List=flatten, Shift=1, Wrap=False)
lng = ListLength(List=pt_2)  # -> flatten(Length)
dist = Distance(PointA=flatten, PointB=shift)
partition = PartitionList(List=dist, Size=lng)

shift_2 = ShiftList(List=pt_2, Shift=1, Wrap=True)
dist_2 = Distance(PointA=pt_2, PointB=shift_2)
shift_3 = ShiftList(List=dist_2, Shift=-1, Wrap=True)

filter_2 = StreamFilter(Gate=print_mode, Stream0=shift_3, Stream1=partition)

# ----
panel = Panel(filter_2)

# ---- group: EULER ANGLES
euler = Panel("""90
90
0""")
pdecon_2 = Deconstruct(Point=pt_2)  # -> XComponent, YComponent, ZComponent
expression_2 = Expression(x=pdecon_2.XComponent, Expression="Round(x,3)")
expression_3 = Expression(x=pdecon_2.YComponent, Expression="Round(x,3)")
expression_4 = Expression(x=pdecon_2.ZComponent, Expression="Round(x,3)")
item_5 = ListItem(List=euler, Index=0, Wrap=True)  # -> Item, Item1, Item2
expression_5 = Expression(
    w=expression_2,
    v=expression_3,
    x=expression_4,
    y=item_5.Item,
    z=item_5.Item1,
    u=item_5.Item2,
    Expression="\"MOVEFLY LINEAR TO POS (\"&w&\",\"&v&\",\"&x&\",\"&y&\",\"&z&\",\"&u&\", 'w') ADVANCE\"")  # -> simplify(graft(R))

# ---- group: EXTRUSION SIMULATION
subset = SubList(List=flatten(pt_2), Domain=Slider(175, range=0..11000), Wrap=False)  # -> List, Index
pline = PolyLine(Vertices=flatten(subset.List), Closed=False)
explode = Explode(Curve=pline, Recursive=True)  # -> Segments, Vertices
eval = EvaluateCurve(Curve=reparameterize(explode.Segments), Parameter=0.5)  # -> Point, Tangent, Angle
preview = CustomPreview(Geometry=explode.Segments, Shader=ColourSwatch(SwatchColor=RGB(247, 0, 255)))

# ---- group: PATH DISPLAY
pline_2 = PolyLine(Vertices=flatten(pt_2), Closed=False)
preview_2 = CustomPreview(Geometry=pline_2, Shader=ColourSwatch(SwatchColor=RGB(0, 81, 168)))

# ---- group: BOOLEAN MASK FOR EXTRUDER SYNCRONIZATION
pt_3 = Point(pt_2)
flatten_2 = FlattenTree(Tree=pt_3, Path="{0}")
filter_3 = StreamFilter(Gate=print_mode, Stream0=pt_3, Stream1=flatten_2)
lng_2 = ListLength(List=filter_3)
item_6 = ListItem(List=filter_3, Index=0, Wrap=True)
lng_3 = ListLength(List=item_6)
subtraction = Subtraction(A=lng_2, B=Slider(3, range=0..10))
repeat = RepeatData(Data="false", Length=lng_3)
repeat_2 = RepeatData(Data="true", Length=subtraction)
# !!! IMPORTANT !!!
# 
# Euler Angle values are not universal and MAY NOT apply to all Comau Robots: they are strictly dependent on the installation settings ($CAL_SYS position with respect to robot $BASE_FRAME)!
# If you are not fully aware of such settings consider asking for Comau technical support.
lng_4 = ListLength(List=pt_3)  # -> flatten(Length)

# ----
repeat_3 = RepeatData(Data="true", Length=lng_3)

# ---- group: BOOLEAN MASK FOR EXTRUDER SYNCRONIZATION (continued)
merge_3 = Merge(Data1=repeat, Data2=repeat_2, Data3=repeat_3, Data4=repeat)  # -> graft(Result)
merge_4 = Merge(Data1=repeat_3, Data2=repeat_2, Data3=repeat_3, Data4=repeat)
partition_2 = PartitionList(List=merge_4, Size=lng_4)  # -> graft(Chunks)
filter_4 = StreamFilter(Gate=print_mode, Stream0=merge_3, Stream1=partition_2)

# ----
unflatten_2 = UnflattenTree(Tree=filter_4, Guide=filter_2)
panel_2 = Panel(unflatten_2)

# ---- group: FORMAT and PARSE ROBOT INSTRUCTIONS
dist_from_points = Number(filter_2)
print_pattern = Data(filter_4)
multiplication = Multiplication(A=dist_from_points, B=extrusion_factor)
expression_6 = Expression(x=multiplication, Expression="Round(x,3)")
panel_3 = Panel("""MOVE TO 
MOVE LINEAR TO""")
panel_4 = Panel("""MOVE LINEAR TO 
MOVEFLY LINEAR TO""")
filter_5 = StreamFilter(Gate=list, Stream0="$ARM_OVR := ", Stream1="$ARM_SPD_OVR := ")
item_7 = ListItem(List=panel_4, Index=interpolation_mode, Wrap=True)
item_8 = ListItem(List=panel_3, Index=interpolation_mode, Wrap=True)
concat = Concatenate(FragmentA=filter_5, FragmentB=int_2)
concat_2 = Concatenate(FragmentA=filter_5, FragmentB=int)

# ---- group: FORMAT and PARSE ROBOT INSTRUCTIONS / set EXTRUSION
expression_7 = Expression(x="WRITE vi_lun_w ('G1 E", y=expression_6, z="', NL) -- Set extrusion ", Expression="x&y&z")

# ---- group: FORMAT and PARSE ROBOT INSTRUCTIONS (continued)
lng_5 = ListLength(List=expression_7)
dup = DuplicateData(Data=expression, Number=lng_5, Order=True)
path_mapper = PathMapper(dup, source=["{A;B;C}", "{A;B;C;D}"], target=["{A;B}", "{A;B;C}"])
weave = Weave(
    Pattern=simplify(print_pattern),
    Stream0=simplify(graft(path_mapper)),
    Stream1=simplify(graft(expression_7)),
    NullGaps=False)  # -> simplify(Weave)
merge_5 = Merge(Data1=simplify(weave), Data2=simplify(expression_5))
path_mapper_2 = PathMapper(merge_5, source=["{A;B}", "{A}"], target=["{A}", "{A}"])
filter_6 = StreamFilter(Gate=print_mode, Stream0=path_mapper_2, Stream1=flatten(path_mapper_2))
ins = InsertItems(List=filter_6, Item=concat, Indices="0", Wrap=True)
ins_2 = InsertItems(List=ins, Item=concat_2, Indices="3", Wrap=True)
flatten_3 = FlattenTree(Tree=ins_2, Path="{0}")
item_9 = ListItem(List=flatten_3, Index="2", Wrap=True)
rep = ReplaceText(Text=item_9, Find=item_7, Replace=item_8, RecursiveReplace=False)
rep_2 = ReplaceText(Text=rep, Find="ADVANCE", Replace=" ", RecursiveReplace=False)
replace_2 = ReplaceItems(List=flatten_3, Item=rep_2, Indices="2", Wrap=False)

# ---- group: HEADER and FOOTER
panel_5 = Panel("""VAR vs_data : STRING[80] NOSAVE
VAR vi_lun_r : INTEGER NOSAVE
VAR vi_lun_w : INTEGER NOSAVE

-- import/export routine
    ROUTINE toolframe (AI_tool,AI_frame,AI_arm : integer()) exported from tt_tool global

BEGIN

DV_CNTRL(4, 'COM1:', COM_BD115200 OR COM_RDAHD OR COM_BIT8 OR COM_PAR_NO OR COM_STOP1 OR COM_PASAL, 65536)
WRITE LUN_CRT ('Error opening Seril Channel ', NL)
OPEN FILE vi_lun_w ('COM1:', 'w')

TOOLFRAME(1,2,1)
$CNFG_CARE := FALSE

MOVE ARM[1] TO $CAL_SYS

$FLY_TYPE := FLY_NORM
$FLY_PER := 20""")
panel_6 = Panel("""WRITE vi_lun_w ('M410', NL) -- motor stop
-- WRITE vi_lun_w ('M104 S25', NL) -- Set low temperature
WRITE vi_lun_w ('M107', NL) -- Fan OFF
MOVE ARM[1] TO $CAL_SYS""")
expression_8 = Expression(
    x="PROGRAM ",
    y=txt,
    z=panel_5,
    v="$ARM_OVR := ",
    w=arm_override_general,
    a=" -- global arm speed",
    Expression="x&y&z&v&w&a")  # -> flatten(R)
concat_3 = Concatenate(FragmentA="END ", FragmentB=txt)
merge_6 = Merge(
    Data1=simplify(flatten(expression_8)),
    Data2=simplify(flatten(replace_2)),
    Data3=simplify(flatten(panel_6)),
    Data4=simplify(flatten(concat_3)))

# ---- group: INSERT TEMPERATURE / SET COORDINATE & DELAY
int_feedrate = Integer(feedrate)
expression_9 = Expression(x="WRITE vi_lun_w ('G1 F", y=int_feedrate, z="', NL) -- Set feedrate", Expression="x&y&z")
int_temp = Integer(temperature)
expression_10 = Expression(x="WRITE vi_lun_w ('M104 S", y=int_temp, z="', NL) -- Set temperature", Expression="x&y&z")
delay_millisec = Integer(delay)
concat_4 = Concatenate(FragmentA="DELAY ", FragmentB=delay_millisec)
merge_7 = Merge(
    Data1="WRITE vi_lun_w ('M106', NL) -- Fan ON",
    Data2="WRITE vi_lun_w ('G91', NL) -- Relative coordinates",
    Data3=expression_9)
merge_8 = Merge(Data1=expression_10, Data2=concat_4, Data3="WRITE vi_lun_w ('G1 E35', NL) -- Check Extrusion ", Data4=concat_4)
ins_3 = InsertItems(List=merge_6, Item=merge_7, Indices="1", Wrap=True)
ins_4 = InsertItems(List=ins_3, Item=merge_8, Indices="4", Wrap=True)

# ---- group: EXPORT CODE FILE
dir = CSharpScript(type=local_directory, dir=custom_subdir)  # -> out, A; inputs type: Int32, dir: String
# ---------- dir: C# ----------
    String S = "";
    String root = "";
    String end = "\\";
    switch(type){
      case 0:
        root = Environment.GetFolderPath(Environment.SpecialFolder.Desktop);
        S = "Desktop";
        break;
      case 1:
        root = "C:";
        S = root+end;
        break;
      case 2:
        root = Environment.GetFolderPath(Environment.SpecialFolder.MyDocuments);
        S = "Documents";
        break;
    }
    A = root + end + (dir != null ? (dir + end):"");
    Component.Message = S;
# ---------- end dir ----------
concat_5 = Concatenate(FragmentA=txt, FragmentB=".pdl")
savetofile = SaveToFile(S=ins_4, dir=dir.A, file=concat_5, clash=Toggle(True), save=save_pdl_file)  # -> out; inputs S: list of String, dir: String, file: String, clash: Boolean, save: Boolean
# ---------- savetofile: C# ----------
    String eol = Environment.NewLine;
    Component.Message = "write to file";
    Component.Name = "Save to File";
    Component.NickName = "SaveToFile";
    Component.Description = "Saves a text sequence to a file";

    if (save){
      if (!Directory.Exists(dir)) Directory.CreateDirectory(dir);

      String target = dir + file;
      if (save && clash){
        System.IO.File.WriteAllLines(target, S.ToArray());
        Print("file saved as: " + target);
      }else if (!clash) Print("WARNING: clash detected | file cannot be saved");
    } else {
      Print("press save button to save pdl file");
    }
# ---------- end savetofile ----------

# ----
# ROBOT INSTRUCTIONS // .pdl CODE PREVIEW
panel_7 = Panel(ins_4)
